# Grasshopper definition 01_basic_planning.ghx (Grasshopper 1.0.8)
# plug-ins: Motus

model = ValueList({"One": 1, "Two": 2, "Three": 2² - 1, "Four": Sqrt(16), "KR 10 R1100", "KR 120 R2700", "KR 16 R2010", "KR 22 R1610", "KR 6 R900", "KR 60 R2100", "LBR iiwa 14 R820", "LBR iiwa 7 R800", "UR10e", "UR16e", "UR20", "UR30", "UR3e", "UR5e"}, selected="UR10e")
joints = MotusJointState(Joints=[0, -1.2, 1, -1.4, -1.5708, 0], UseDegrees=False)
robot = MotusRobot(Model=model)
plan = MotusPlan(Robot=robot, Goal=joints)  # -> Trajectory, Status, Warnings
preview = MotusPreview(Trajectory=plan.Trajectory)  # -> Meshes, Links, TCPPath, State, Time, Index, Invalid
export = MotusExport(Trajectory=plan.Trajectory)  # -> Json, Csv
