# Grasshopper definition 01_joint_planning.ghx (Grasshopper 1.0.8)
# plug-ins: Motus
# Joint-linear planning: UR10e Robotiq + Joint State -> Plan -> Preview / Export / Trajectory Data. Click Plan, then drag Motus Scrub or Play.

ur10e = MotusUR10eRobotiq()
joints = MotusJointState(Joints=[1.2, -1, 1.2, -1.6, -1.5708, 0])
scrub = Slider(0, range=0..1)
quick = MotusPlan(Robot=ur10e, Goal=joints, Step=0.005, ShowCollision=False, ShowGroup=False, ShowAttach=False, ShowRrtSettings=False)  # -> Trajectory, Status, Warnings
preview = MotusPreview(Trajectory=quick.Trajectory, ShowStart=False, Position=scrub)  # -> Meshes, Links, TCPPath, State, Time
data = MotusTrajectoryData(Trajectory=quick.Trajectory)  # -> Planes, Times, Joints, ToolStates
export = MotusExport(Trajectory=quick.Trajectory, Retime=True, Validate=False)  # -> Json, Csv, Validation
