# Grasshopper definition 01_quick_plan.ghx (Grasshopper 1.0.8)
# plug-ins: Motus
# Quick plan: sequential Joint State + TCP Pose LIN + Plane goal (via Merge) -> Preview / Export / Trajectory Data. Auto Plan on; drag Motus Scrub or Play.

# ---- group: Robot + start
# 01  Quick plan
ur10e = MotusUR10eRobotiq()
joints = MotusJointState(Joints=[0, -0.5, 1, -1, 0, 0])

# ---- group: Goals (merge → Plan)
joints_2 = MotusJointState(Joints=[1.2, -1, 1.2, -1.6, -1.5708, 0])
Z = UnitZ()
goalpt = ConstructPoint(X=0.48, Y=0.18, Z=0.48)
pl = PlaneNormal(Origin=goalpt, ZAxis=Z)
tcp = MotusTCPPose(Robot=ur10e, State=joints_2)
merge = Merge(Data1=joints_2, Data2=tcp, Data3=pl)

# ---- group: Plan + preview
# Note: Auto Plan on. Scrub Preview when Status OK.
quick = MotusPlan(
    Robot=ur10e,
    Goal=merge,
    Start=joints,
    Step=0.005,
    AutoPlan=True,
    ShowCollision=False,
    ShowGroup=False,
    ShowAttach=False,
    ShowRrtSettings=False)  # -> Trajectory, Status, Warnings
scrub = Slider(0, range=0..1)
preview = MotusPreview(
    Trajectory=quick.Trajectory,
    ShowStart=False,
    Position=scrub,
    ColorMode=0,
    ShowCustomColors=False,
    ShowDebugOutputs=False)  # -> Meshes, Links, TCPPath, State, Time
data = MotusTrajectoryData(Trajectory=quick.Trajectory)  # -> Planes, Times, Joints, ToolStates
export = MotusExport(Trajectory=quick.Trajectory, Retime=True, Validate=False)  # -> Json, Csv, Validation
