# Grasshopper definition 02_cartesian_planning.ghx (Grasshopper 1.0.8)
# plug-ins: Motus
# Cartesian TCP LIN: Joint State -> TCP Pose (FK plane) -> Plan. Click Plan, then drag Motus Scrub or Play on Preview.

ur10e = MotusUR10eRobotiq()
joints = MotusJointState(Joints=[1.2, -1, 1.2, -1.6, -1.5708, 0])
tcp = MotusTCPPose(Robot=ur10e, State=joints)
scrub = Slider(0, range=0..1)
quick = MotusPlan(Robot=ur10e, Goal=tcp, Step=0.005, ShowCollision=False, ShowGroup=False, ShowAttach=False, ShowRrtSettings=False)  # -> Trajectory, Status, Warnings
preview = MotusPreview(Trajectory=quick.Trajectory, ShowStart=False, Position=scrub)  # -> Meshes, Links, TCPPath, State, Time
