# Grasshopper definition 02_collision_srdf.ghx (Grasshopper 1.0.8)
# plug-ins: Motus
# Collision RRT: sphere blocks the joint-linear mid-path so Plan detours. ColSphere+ColBox via Merge → ColScene (SRDF) + Attach + RRT. Auto Plan on; scrub Preview.

# ---- group: Robot + joints
# 02  Collision + SRDF
# Note: RRT detours the sphere. Group pin unwired until OMPL fix.
ur10e = MotusUR10eRobotiq()
joints = MotusJointState(Joints=[0, -1.4, 1.4, -1.7, -1.5708, 0])
joints_2 = MotusJointState(Joints=[1, -0.9, 1, -1.4, -1.5708, 0.3])

# ---- group: Obstacles + SRDF
goalpt = ConstructPoint(X=0.76, Y=0.5, Z=0.73)
Z = UnitZ()
goalpt_2 = ConstructPoint(X=0.7, Y=0.2, Z=0.04)
srdf = Panel("/Users/lasaths/Documents/GitHub/Motus.Grasshopper/examples/srdf/table_base.srdf")
pl = PlaneNormal(Origin=goalpt_2, ZAxis=Z)
colsph = MotusCollisionSphere(Center=goalpt, Radius=0.18, Name="block")
colbox = MotusCollisionBox(Plane=pl, HalfX=0.25, HalfY=0.18, HalfZ=0.02, Name="table")
merge = Merge(Data1=colsph, Data2=colbox)
colscene = MotusCollisionScene(Objects=merge, Srdf=srdf)  # -> Scene, Groups, EndEffectors
group = MotusPlanningGroup(Group=colscene.Groups, Name="manipulator", BaseLink="base_link", TipLink="tool0")

# ---- group: Attach + RRT
goalpt_3 = ConstructPoint(X=0, Y=0, Z=0.02)
colsph_2 = MotusCollisionSphere(Center=goalpt_3, Radius=0.03, Name="grasp")
attach = MotusAttachBody(Object=colsph_2, Name="grasp")
rrtset = MotusRRTSettings(MaxIter=4000, TimeLimit=30, Planner="RrtConnect", GoalBias=0.08, Step=0.12)

# ---- group: Plan + preview
quick = MotusPlan(
    Robot=ur10e,
    Goal=joints_2,
    Start=joints,
    Step=0.005,
    Collision=colscene.Scene,
    Attach=attach,
    RrtSettings=rrtset,
    AutoPlan=True,
    ShowCollision=True,
    ShowGroup=True,
    ShowAttach=True,
    ShowRrtSettings=True)  # -> Trajectory, Status, Warnings
scrub = Slider(0, range=0..1)
preview = MotusPreview(
    Trajectory=quick.Trajectory,
    ShowStart=False,
    Position=scrub,
    ColorMode=0,
    ShowCustomColors=False,
    ShowDebugOutputs=False)  # -> Meshes, Links, TCPPath, State, Time
