# Grasshopper definition 03_collision_rrt.ghx (Grasshopper 1.0.8)
# plug-ins: Pufferfish, Motus
# Collision-aware RRT: ColSphere -> ColScene -> Plan.Collision with Motus RRT Settings on joint goal. Click Plan, then drag Motus Scrub or Play.

number_slider = Slider(1.1, range=0..10)
box = CenterBox(Base=PlaneXY(0, 0, 0), X=number_slider, Y=number_slider, Z=expr("x/2", number_slider))
planner = ValueList({"RrtConnect"}, selected="RrtConnect")
pop3d = Populate3D(Region=box, Count=Slider(12, range=0..100), Seed=Slider(6, range=0..10))
colsph = MotusCollisionSphere(Center=pop3d, Radius=0.1, Name="sphere")
joints = MotusJointState(Joints=[1.2, -1, 1.2, -1.6, -1.5708, 0])
ur10e = MotusUR10eRobotiq(ShowCollisionPreview=True)
Z = UnitZ(Factor=Slider(0.5, range=0..1))
xy = XYPlane(Origin="0.75,0.75,0")
flippln = FlipPlane(Plane=xy, FlipX=False, FlipY=False, FlipZ=True)  # -> Flipped, R
rrtset = MotusRRTSettings(TimeLimit=30, Planner=planner, GoalBias=0.08, Step=0.12)
colscene = MotusCollisionScene(Objects=colsph)  # -> Scene, Groups, EndEffectors
move = Move(Geometry=flippln.Flipped, Motion=Z)  # -> Geometry, Transform
scrub = Slider(1, range=0..1)
plan = MotusPlan(
    Robot=ur10e,
    Goal=joints,
    Step=0.005,
    Collision=colscene.Scene,
    AutoPlan=False,
    ShowAttach=True,
    ShowCollision=True,
    ShowGroup=True,
    ShowRrtSettings=True)  # -> Trajectory, Status, Warnings
preview = MotusPreview(Trajectory=plan.Trajectory, ShowStart=False, Position=scrub, ColorMode=0, ShowCustomColors=False, ShowDebugOutputs=True)  # -> Meshes, Links, TCPPath, State, Time, Index, Invalid, ToolState, Width
