# Grasshopper definition 03_urdf_tool_frames.ghx (Grasshopper 1.0.8)
# plug-ins: Motus
# Motus Robot URDF + Base override + Robotiq Tool (Load Mesh, Cap=Robotiq2F85) + Start + Preview ShowStart. Auto Plan on.

# ---- group: URDF + base
# 03  URDF + tool frames
path = FilePath("C:\Users\lasaths\GitHub\Motus.Grasshopper\resources\robots\ur10e_robotiq\ur10e_robotiq.urdf")
xy = XYPlane()

# ---- group: Tool TCP + mesh
goalpt = ConstructPoint(X=0, Y=0, Z=0.1633)
X = UnitX()
path_2 = FilePath("C:\Users\lasaths\GitHub\Motus.Grasshopper\resources\tools\robotiq_2f85_tcp_local.stl")
pl = PlaneNormal(Origin=goalpt, ZAxis=X)
loadmesh = MotusLoadMesh(Path=path_2)
tool = MotusTool(
    Name="robotiq_2f85",
    TCP=pl,
    Geometry=loadmesh,
    WidthMin=0,
    WidthMax=0.085,
    ClosedDriver=0.8,
    ToolCapabilities="Robotiq2F85",
    CanvasPivotX=488,
    CanvasPivotY=402)

# ---- group: Plan + preview
# Note: Custom URDF + Tool TCP. Preview ShowStart on.
robot = MotusRobot(Path=path, BaseLink="base_link", TipLink="tool0", Base=xy, Tool=tool, AllDrivers=False, AttachOrigin=[0, 0, 0])
joints = MotusJointState(Joints=[0, -1.2, 1.2, -1.6, -1.5708, 0])
joints_2 = MotusJointState(Joints=[1.2, -1, 1.2, -1.6, -1.5708, 0])
quick = MotusPlan(
    Robot=robot,
    Goal=joints_2,
    Start=joints,
    Step=0.005,
    AutoPlan=True,
    ShowCollision=False,
    ShowGroup=False,
    ShowAttach=False,
    ShowRrtSettings=False)  # -> Trajectory, Status, Warnings
scrub = Slider(0, range=0..1)
preview = MotusPreview(Trajectory=quick.Trajectory, ShowStart=True, Position=scrub, ColorMode=0, ShowCustomColors=False, ShowDebugOutputs=False)  # -> Meshes, Links, TCPPath, State, Time
export = MotusExport(Trajectory=quick.Trajectory, Retime=True, Validate=False, Retimer="TotgLite")  # -> Json, Csv, Validation
