# Grasshopper definition 04_collision_shapes.ghx (Grasshopper 1.0.8)
# plug-ins: Motus
# Multiple obstacle shapes: ColSphere + ColBox -> ColScene -> Plan (RRT). Wire your own mesh into ColMesh the same way.

ur10e = MotusUR10eRobotiq()
joints = MotusJointState(Joints=[1.2, -1, 1.2, -1.6, -1.5708, 0])
colsph = MotusCollisionSphere(Center=[0.35, 0.15, 0.35], Radius=0.12, Name="sphere")
xy = XYPlane()
colbox = MotusCollisionBox(Plane=xy, HalfX=0.15, HalfY=0.08, HalfZ=0.4, Name="table")
colscene = MotusCollisionScene(Objects=[colsph, colbox])  # -> Scene, Groups, EndEffectors
scrub = Slider(0, range=0..1)
quick = MotusPlan(
    Robot=ur10e,
    Goal=joints,
    Step=0.005,
    Collision=colscene.Scene,
    ShowCollision=True,
    ShowGroup=False,
    ShowAttach=False,
    ShowRrtSettings=False)  # -> Trajectory, Status, Warnings
preview = MotusPreview(Trajectory=quick.Trajectory, ShowStart=False, Position=scrub)  # -> Meshes, Links, TCPPath, State, Time
