# Grasshopper definition 04_motion_program.ghx (Grasshopper 1.0.8)
# plug-ins: Motus
# Motion program: PTP + LIN + CIRC + SET gripper (via Merge) -> Motus Program -> Preview / Export. Auto Plan on; drag Motus Scrub or Play.

preset = ValueList({"Open", "Closed", "Custom"}, selected="Closed")
preset_2 = ValueList({"Open", "Closed", "Custom"}, selected="Open")

# ---- group: 2 LIN
goalpt = ConstructPoint(X=0.45, Y=0.15, Z=0.45)
Z = UnitZ(Factor=1)
pl = PlaneNormal(Origin=goalpt, ZAxis=Z)
move = MotusMove(Type="LIN", Goal=pl, Blend=0, Step=0.005, CanvasPivotX=405, CanvasPivotY=538, MotionType="LIN", ToolMode="Hold")

# ---- group: Robot + start
joints = MotusJointState(Joints=[0, -0.5, 1, -1, 0, 0])
# 04  Motion program
ur10e = MotusUR10eRobotiq(ShowCollisionPreview=False)

# ---- group: 1 PTP
joints_2 = MotusJointState(Joints=[1.2, -1, 1.2, -1.6, -1.5708, 0])
toolstate = MotusToolState(Tool=ur10e, Preset=preset_2, Width=0.085, Speed=0.5, Force=0.5)
# Note: One row per move → Merge → Program. Scrub when Status OK.
move_2 = MotusMove(
    Type="PTP",
    Goal=joints_2,
    Blend=0,
    ToolState=toolstate,
    CanvasPivotX=389,
    CanvasPivotY=287,
    MotionType="PTP",
    ToolMode="Hold")

# ---- group: 4 SET
toolstate_2 = MotusToolState(Tool=ur10e, Preset=preset, Width=0.085, Speed=0.5, Force=0.5)
move_3 = MotusMove(Type="SET", ToolState=toolstate_2, Duration=0.2, CanvasPivotX=372, CanvasPivotY=1078, MotionType="SET", ToolMode="Hold")

# ---- group: 3 CIRC
goalpt_2 = ConstructPoint(X=0.453, Y=0.152, Z=0.45)
goalpt_3 = ConstructPoint(X=0.45, Y=0.154, Z=0.45)
pl_2 = PlaneNormal(Origin=goalpt_2, ZAxis=Z)
pl_3 = PlaneNormal(Origin=goalpt_3, ZAxis=Z)
move_4 = MotusMove(
    Type="CIRC",
    Goal=pl_3,
    Blend=0,
    ToolState=toolstate_2,
    Via=pl_2,
    CanvasPivotX=379,
    CanvasPivotY=840,
    MotionType="CIRC",
    ToolMode="Hold")

# ---- group: Merge → Program
merge = Merge(Data1=move_2, Data2=move, Data3=move_4, Data4=move_3)
program = MotusProgram(Robot=ur10e, Segments=merge, Start=joints, AutoPlan=True)  # -> Trajectory, Status, Warnings

# ---- group: Preview + export
scrub = Slider(1, range=0..1)
export = MotusExport(Trajectory=program.Trajectory, Retime=True, Validate=False)  # -> Json, Csv, Validation
preview = MotusPreview(
    Trajectory=program.Trajectory,
    ShowStart=True,
    Position=scrub,
    ColorMode=0,
    ShowCustomColors=False,
    ShowDebugOutputs=False)  # -> Meshes, Links, TCPPath, State, Time

# ----
export_2 = MotusExport(Trajectory=program.Trajectory, Retime=True, Validate=False)  # -> Json, Csv, Validation
