# Grasshopper definition 05_srdf_group_attach.ghx (Grasshopper 1.0.8)
# plug-ins: Motus
# SRDF allowed pairs + Planning Group + Attach Body on Plan. Set Srdf panel to your absolute path if needed.

srdf = Panel("examples/srdf/table_base.srdf")
ur10e = MotusUR10eRobotiq()
joints = MotusJointState(Joints=[1.2, -1, 1.2, -1.6, -1.5708, 0])
goalpt = ConstructPoint(X=0.35, Y=0.15, Z=0.35)
colsph = MotusCollisionSphere(Center=goalpt, Radius=0.12, Name="table")
goalpt_2 = ConstructPoint(X=0, Y=0, Z=0.08)
colsph_2 = MotusCollisionSphere(Center=goalpt_2, Radius=0.05, Name="grasp")
colscene = MotusCollisionScene(Objects=colsph, Srdf=srdf)  # -> Scene, Groups, EndEffectors
attach = MotusAttachBody(Object=colsph_2, Name="grasp")
group = MotusPlanningGroup(Group=colscene.Groups, Name="manipulator", BaseLink="base_link", TipLink="tool0")
scrub = Slider(0, range=0..1)
quick = MotusPlan(
    Robot=ur10e,
    Goal=joints,
    Step=0.005,
    Collision=colscene.Scene,
    Group=group,
    Attach=attach,
    ShowCollision=True,
    ShowGroup=True,
    ShowAttach=True,
    ShowRrtSettings=False)  # -> Trajectory, Status, Warnings
preview = MotusPreview(Trajectory=quick.Trajectory, ShowStart=False, Position=scrub)  # -> Meshes, Links, TCPPath, State, Time
