# Grasshopper definition 06_turntable_group.ghx (Grasshopper 1.0.8)
# plug-ins: Motus
# Turntable+arm URDF: coupled Plan (Group unwired) vs decoupled Plan (arm Group locks turntable). Shared RRT scene; scrub both Previews.

# ---- group: URDF + joints
# 06  Turntable + Group
path = FilePath("C:\Users\lasaths\GitHub\Motus.Grasshopper\examples\urdf\turntable_arm.urdf")
joints = MotusJointState(Joints=[0, 0.4, -0.9, 0.6])
joints_2 = MotusJointState(Joints=[1.2, 0.8, -0.5, 0.2])
# Note: Coupled: Group unwired (turntable moves). Decoupled: arm group locks turntable. Scrub both Previews.
robot = MotusRobot(Path=path, BaseLink="base_link", TipLink="tool0")

# ---- group: Scene + arm group
goalpt = ConstructPoint(X=2, Y=2, Z=0.4)
colsph = MotusCollisionSphere(Center=goalpt, Radius=0.08, Name="keepout")
colscene = MotusCollisionScene(Objects=colsph)  # -> Scene, Groups, EndEffectors
group = MotusPlanningGroup(Name="arm", BaseLink="turntable_link", TipLink="tool0", Joints=["shoulder", "elbow", "wrist"])
rrtset = MotusRRTSettings(MaxIter=4000, TimeLimit=30, Planner="RrtConnect", GoalBias=0.08, Step=0.12)

# ---- group: Coupled (no Group)
quick = MotusPlan(
    Robot=robot,
    Goal=joints_2,
    Start=joints,
    Step=0.005,
    Collision=colscene.Scene,
    RrtSettings=rrtset,
    AutoPlan=True,
    ShowCollision=True,
    ShowGroup=False,
    ShowAttach=False,
    ShowRrtSettings=True)  # -> Trajectory, Status, Warnings
scrub = Slider(0, range=0..1)
preview = MotusPreview(Trajectory=quick.Trajectory, ShowStart=True, Position=scrub, ColorMode=0, ShowCustomColors=False, ShowDebugOutputs=False)  # -> Meshes, Links, TCPPath, State, Time

# ---- group: Decoupled (arm Group)
quick_2 = MotusPlan(
    Robot=robot,
    Goal=joints_2,
    Start=joints,
    Step=0.005,
    Collision=colscene.Scene,
    Group=group,
    RrtSettings=rrtset,
    AutoPlan=True,
    ShowCollision=True,
    ShowGroup=True,
    ShowAttach=False,
    ShowRrtSettings=True)  # -> Trajectory, Status, Warnings
scrub_2 = Slider(0, range=0..1)
preview_2 = MotusPreview(
    Trajectory=quick_2.Trajectory,
    ShowStart=True,
    Position=scrub_2,
    ColorMode=0,
    ShowCustomColors=False,
    ShowDebugOutputs=False)  # -> Meshes, Links, TCPPath, State, Time
