# Grasshopper definition 06_urdf_load.ghx (Grasshopper 1.0.8)
# plug-ins: Motus
# URDF import: Path → ur10e.urdf (run fetch-ur10e-assets.mjs for meshes), joint start/goal in °, Plan + Preview.

goal = Panel("""0
-80
0
-90
0
0""")
path = FilePath("C:\Users\lasaths\GitHub\Motus.Grasshopper\examples\ur10e\ur10e.urdf")
start = Panel("""0
-90
0
-90
0
0""")
urdf = MotusLoadURDF(Path=path, BaseLink="base_link", TipLink="tool0")
joints = MotusJointState(Joints=goal)
joints_2 = MotusJointState(Joints=start)
plan = MotusPlan(Robot=urdf, Goal=joints, Start=joints_2, AutoPlan=False)  # -> Trajectory, Status, Warnings
preview = MotusPreview(Trajectory=plan.Trajectory, ShowStart=False, Robot=urdf)  # -> Meshes, Links, TCPPath, State, Time, Index, Invalid
