# Grasshopper definition 07_frames_and_start.ghx (Grasshopper 1.0.8)
# plug-ins: Motus
# Base override + Motus Tool TCP on Robot, explicit Start on Plan, ShowStart ghost on Preview.

model = ValueList({"KR 10 R1100", "KR 120 R2700", "KR 16 R2010", "KR 22 R1610", "KR 6 R900", "KR 60 R2100", "LBR iiwa 14 R820", "LBR iiwa 7 R800", "UR10e", "UR16e", "UR20", "UR30", "UR3e", "UR5e"}, selected="UR10e")
xy = XYPlane()
xy_2 = XYPlane()
tool = MotusTool(Name="offset", TCP=xy_2)
robot = MotusRobot(Model=model, Base=xy, Tool=tool)
joints = MotusJointState(Joints=[0, -1.2, 1.2, -1.6, -1.5708, 0])
joints_2 = MotusJointState(Joints=[1.2, -1, 1.2, -1.6, -1.5708, 0])
plan = MotusPlan(Robot=robot, Goal=joints_2, Start=joints)  # -> Trajectory, Status, Warnings
preview = MotusPreview(Trajectory=plan.Trajectory, ShowStart=True)  # -> Meshes, Links, TCPPath, State, Time, Index, Invalid
