# Grasshopper definition 07_urdf_gripper_tool.ghx (Grasshopper 1.0.8)
# plug-ins: Motus
# Boxes→ULink→UJoint→Assemble→Tool Rd (Cap=Custom, Bd=j_left)→ur10e_minimal→PTP Ramp Closed→Preview pinch.

# ---- group: Author gripper
# 07 · Gripper Tool pinch
# Note: L→R: boxes→Assemble→Tool (Cap=Custom, Bd=j_left)→Robot→PTP Ramp Closed. Scrub = pinch.
xy = XYPlane()
Z = UnitZ()
box = CenterBox(Base=xy, X=0.1, Y=0.08, Z=0.02)
goalpt = ConstructPoint(X=-0.045, Y=0, Z=0.055)
pl = PlaneNormal(Origin=goalpt, ZAxis=Z)
box_2 = CenterBox(Base=pl, X=0.07, Y=0.012, Z=0.08)
box_3 = CenterBox(Base=pl, X=0.07, Y=0.012, Z=0.08)
ulink = MotusUrdfLink(Name="palm", Visual=box)
ulink_2 = MotusUrdfLink(Name="L", Visual=box_2)
ulink_3 = MotusUrdfLink(Name="R", Visual=box_3)
goalpt_2 = ConstructPoint(X=0, Y=0.035, Z=0)
goalpt_3 = ConstructPoint(X=0, Y=-0.035, Z=0)
ln = LineSDL(Start=goalpt_2, Direction=Z, Length=0.05)
ln_2 = LineSDL(Start=goalpt_3, Direction=Z, Length=0.05)
ujoint = MotusUrdfJoint(Name="j_left", Type="Revolute", Parent="palm", Child="L", Axis=ln, Lower=0, Upper=0.8, MimicMult=1, MimicOffset=0)
ujoint_2 = MotusUrdfJoint(
    Name="j_right",
    Type="Revolute",
    Parent="palm",
    Child="R",
    Axis=ln_2,
    Lower=0,
    Upper=0.8,
    MimicJoint="j_left",
    MimicMult=-1,
    MimicOffset=0)
merge = Merge(Data1=ulink, Data2=ulink_2, Data3=ulink_3)
merge_2 = Merge(Data1=ujoint, Data2=ujoint_2)
uassemble = MotusUrdfAssemble(Name="demo_gripper", Links=merge, Joints=merge_2, Tip="palm")

# ---- group: Tool Rd
tool = MotusTool(
    Name="demo_gripper",
    Description=uassemble,
    Binding="j_left",
    WidthMin=0,
    WidthMax=0.085,
    ClosedDriver=0.8,
    ToolCapabilities="Custom",
    CanvasPivotX=1428,
    CanvasPivotY=242)
toolstate = MotusToolState(Tool=tool, Width=0.085, Speed=0.5, Force=0.5, ToolStatePreset="Closed", CanvasPivotX=1428, CanvasPivotY=472)

# ---- group: Arm + Preview
urdf = Panel("ur10e/ur10e_minimal.urdf")
robot = MotusRobot(Path=urdf, BaseLink="base_link", TipLink="tool0", Tool=tool, AllDrivers=False)
joints = MotusJointState(Joints=[0, -1.2, 1.2, -1.6, -1.5708, 0])
joints_2 = MotusJointState(Joints=[1.2, -1, 1.2, -1.6, -1.5708, 0])
move = MotusMove(
    Type="PTP",
    Goal=joints_2,
    Blend=0,
    ToolState=toolstate,
    MotionType="PTP",
    ToolMode="Ramp",
    CanvasPivotX=1457,
    CanvasPivotY=622)
program = MotusProgram(Robot=robot, Segments=move, Start=joints, AutoPlan=True)  # -> Trajectory, Status, Warnings
scrub = Slider(0, range=0..1)
preview = MotusPreview(
    Trajectory=program.Trajectory,
    ShowStart=True,
    Position=scrub,
    ColorMode=0,
    ShowCustomColors=False,
    ShowDebugOutputs=False)  # -> Meshes, Links, TCPPath, State, Time
