# Grasshopper definition 08_motion_program.ghx (Grasshopper 1.0.8)
# plug-ins: Motus
# Motion program: PTP + LIN + CIRC segments -> Program Plan -> Preview / Export. Click Plan, then drag Motus Scrub or Play.

ur10e = MotusUR10eRobotiq()
joints = MotusJointState(Joints=[0, -0.5, 1, -1, 0, 0])
joints_2 = MotusJointState(Joints=[1.2, -1, 1.2, -1.6, -1.5708, 0])
Z = UnitZ()
goalpt = ConstructPoint(X=0.45, Y=0.15, Z=0.45)
goalpt_2 = ConstructPoint(X=0.453, Y=0.152, Z=0.45)
goalpt_3 = ConstructPoint(X=0.45, Y=0.154, Z=0.45)
goal = Plane(Origin=goalpt, Normal=Z)
goal_2 = Plane(Origin=goalpt_2, Normal=Z)
goal_3 = Plane(Origin=goalpt_3, Normal=Z)
segment = MotusMotionSegment(Type="PTP", Goal=joints_2, Step=0.005, Samples=16, Blend=0, ToolMode="Hold", Duration=0)
segment_2 = MotusMotionSegment(Type="LIN", Goal=goal, Step=0.005, Samples=16, Blend=0, ToolMode="Hold", Duration=0)
segment_3 = MotusMotionSegment(Type="CIRC", Goal=goal_3, Via=goal_2, Step=0.005, Samples=16, Blend=0, ToolMode="Hold", Duration=0)
scrub = Slider(0, range=0..1)
progplan = MotusProgramPlan(Robot=ur10e, Segments=[segment, segment_2, segment_3], Start=joints)  # -> Trajectory, Status, Warnings
preview = MotusPreview(Trajectory=progplan.Trajectory, ShowStart=False, Position=scrub)  # -> Meshes, Links, TCPPath, State, Time, Index, Invalid, ToolState, Width
export = MotusExport(Trajectory=progplan.Trajectory, Retime=True, Validate=False)  # -> Json, Csv, Validation
