# Grasshopper definition 09_tool_tcp.ghx (Grasshopper 1.0.8)
# plug-ins: Motus
# Motus Robot (ur10e.urdf) + Motus Tool (TCP + gripper box) -> Plan -> Preview/Export.

path = FilePath("examples/ur10e/ur10e.urdf")
xy = XYPlane()
colbox = MotusCollisionBox(HalfX=0.02, HalfY=0.02, HalfZ=0.04, Name="gripper_geom")
tool = MotusTool(Name="gripper", TCP=xy, Geometry=colbox, Capabilities="None")
robot = MotusRobot(Path=path, BaseLink="base_link", TipLink="tool0", Tool=tool)
joints = MotusJointState(Joints=[1.2, -1, 1.2, -1.6, -1.5708, 0])
scrub = Slider(0, range=0..1)
quick = MotusPlan(Robot=robot, Goal=joints, Step=0.005, ShowCollision=False, ShowGroup=False, ShowAttach=False, ShowRrtSettings=False)  # -> Trajectory, Status, Warnings
preview = MotusPreview(Trajectory=quick.Trajectory, ShowStart=False, Position=scrub)  # -> Meshes, Links, TCPPath, State, Time
export = MotusExport(Trajectory=quick.Trajectory, Retime=True, Validate=False)  # -> Json, Csv, Validation
