# Grasshopper definition 10_pick_place.ghx (Grasshopper 1.0.8)
# plug-ins: Motus, Cassis
# UR10e destack 5×4 rotating tower → 5 columns × 4 via Motus Pick Place (one Program). Z-down home; SET open 0.085 / close 0.04. PickPlace Touch=robotiq_2f85. Plan ColScene = table only.

c_script = CSharpScript()  # -> out, a
# ---------- c_script: C# ----------
// Grasshopper Script Instance
#region Usings
using System;
using System.Collections.Generic;
#endregion

public class Script_Instance : GH_ScriptInstance
{
    private void RunScript(ref object a)
    {
        // Fingers-down for Robotiq mesh (fingers along −Motus approach):
        // Motus X = world +Z → Rhino TCP Z = +Z. J5 = −π/2 (was +π/2 → fingers up).
        a = new List<double> { 0, -Math.PI / 2, Math.PI / 2, -Math.PI / 2, -Math.PI / 2, 0 };
    }
}
# ---------- end c_script ----------
goalpt = ConstructPoint(X=0.7, Y=0, Z=0.48)
goalpt_2 = ConstructPoint(X=0.7, Y=-0.25, Z=0.48)

# ---- group: Robot + Z-down home
ur10e = MotusUR10eRobotiq(ShowCollisionPreview=False, ShowTcp=False)
# 10  Tower destack
joints = MotusJointState(Joints=c_script.a)
# Note: 5×4 rotating tower → 5 columns × 4. Layout = C# script (not Motus Tower). Grasp/place TCP Z = world +Z (Robotiq fingers world −Z). SET open 0.085 / close 0.04. PickPlace Touch=robotiq_2f85. Plan ColScene = table only.
tcp = MotusTCPPose(Robot=ur10e, State=joints)

# ----
c_script_2 = CSharpScript(Tower=goalpt, Columns=goalpt_2)  # -> out, Brick, Grasp, Place; inputs Tower: Point3d, Columns: Point3d, Levels: Double, HalfX: Double, HalfY: Double, HalfZ: Double, ColPitch: Double, ColumnsN: Double
# ---------- c_script_2: C# ----------
// Grasshopper Script Instance
#region Usings
using System;
using System.Collections.Generic;
using Rhino.Geometry;
using Grasshopper.Kernel;
#endregion

public class Script_Instance : GH_ScriptInstance
{
    private void RunScript(
		Point3d Tower,
		Point3d Columns,
		double Levels,
		double HalfX,
		double HalfY,
		double HalfZ,
		double ColPitch,
		double ColumnsN,
		ref object Brick,
		ref object Grasp,
		ref object Place)
    {
        // 5×4 rotating tower destack (top-first) → 5 columns × 4.
        // Rhino Z → Motus X (approach). Robotiq mesh fingers along −approach,
        // so fingers-down needs Motus X = world +Z = Rhino plane Z +Z.
        if (HalfX <= 0) HalfX = 0.04;
        if (HalfY <= 0) HalfY = 0.02;
        if (HalfZ <= 0) HalfZ = 0.01;
        if (ColPitch <= 0) ColPitch = 0.10;
        int levels = Math.Max(1, (int)Math.Round(Levels <= 0 ? 5 : Levels));
        int columnsN = Math.Max(1, (int)Math.Round(ColumnsN <= 0 ? 5 : ColumnsN));
        const int perLevel = 4;
        int total = levels * perLevel;
        if (columnsN * perLevel < total)
        {
            Component.AddRuntimeMessage(GH_RuntimeMessageLevel.Error,
                $"Need ColumnsN×4 >= Levels×4 (have {columnsN * 4}, need {total}).");
            return;
        }

        var bricks = new List<Plane>(total);
        var grasps = new List<Plane>(total);
        var places = new List<Plane>(total);

        var offs = new[]
        {
            (-HalfX, -HalfY), (HalfX, -HalfY),
            (-HalfX, HalfY), (HalfX, HalfY)
        };

        Plane FingersDownTcp(Point3d origin, Vector3d shortAxis)
        {
            var x = Vector3d.CrossProduct(shortAxis, Vector3d.ZAxis);
            var up = Vector3d.ZAxis;
            var y = Vector3d.CrossProduct(up, x);
            if (!x.Unitize() || !y.Unitize())
                return new Plane(origin, Vector3d.ZAxis);
            // Robotiq closes along TCP Z = Rhino plane Y. Align it with the short edge.
            // Both grasp and place use this roll; Z stays world +Z.
            return new Plane(origin, -x, -y);
        }

        for (int level = levels - 1; level >= 0; level--)
        {
            double yaw = level * (Math.PI / 2.0);
            double cos = Math.Cos(yaw);
            double sin = Math.Sin(yaw);
            double z = Tower.Z + HalfZ + level * (2.0 * HalfZ);
            foreach (var (lx, ly) in offs)
            {
                double wx = Tower.X + lx * cos - ly * sin;
                double wy = Tower.Y + lx * sin + ly * cos;
                var brick = new Plane(
                    new Point3d(wx, wy, z),
                    new Vector3d(cos, sin, 0),
                    new Vector3d(-sin, cos, 0));
                grasps.Add(FingersDownTcp(brick.Origin, brick.YAxis));
                bricks.Add(brick);
            }
        }

        for (int i = 0; i < total; i++)
        {
            int col = i / perLevel;
            int height = i % perLevel;
            double z = Columns.Z + HalfZ + height * (2.0 * HalfZ);
            var origin = new Point3d(Columns.X, Columns.Y - col * ColPitch, z);
            places.Add(FingersDownTcp(origin, Vector3d.YAxis));
        }

        Brick = bricks;
        Grasp = grasps;
        Place = places;
    }
}
# ---------- end c_script_2 ----------
boxes = MotusCollisionBoxes(Planes=c_script_2.Brick, HalfX=0.04, HalfY=0.02, HalfZ=0.01, Prefix="b")

# ---- group: Table + scenes
Z = UnitZ(Factor=1)
goalpt_3 = ConstructPoint(X=0.7, Y=-0.2, Z=0.46)
pl = PlaneNormal(Origin=goalpt_3, ZAxis=Z)
colbox = MotusCollisionBox(Plane=pl, HalfX=0.22, HalfY=0.5, HalfZ=0.02, Name="table")
merge = Merge(Data1=flatten(boxes), Data2=flatten(colbox))
colscene = MotusCollisionScene(Objects=colbox)  # -> Scene, Groups, EndEffectors
colscene_2 = MotusCollisionScene(Objects=merge)  # -> Scene, Groups, EndEffectors

# ----
colscene_3 = MotusCollisionScene()  # -> Scene, Groups, EndEffectors

# ---- group: Pick Place → Program
pickplace = MotusPickPlace(
    Grasp=c_script_2.Grasp,
    Place=c_script_2.Place,
    Objects=boxes,
    Approach=0.08,
    Wopen=0.085,
    Wclose=0.04,
    Step=0.005,
    SamplingTransfers=False,
    TouchBodies="robotiq_2f85")
program = MotusProgram(Robot=ur10e, Segments=pickplace, Start=joints, Collision=colscene_3.Scene, AutoPlan=True)  # -> Trajectory, Status, Warnings

# ----
c_script_3 = CSharpScript()  # -> out, a; disabled
# ---------- c_script_3: C# ----------
// Grasshopper Script Instance
#region Usings
using System;
using System.Reflection;
using Grasshopper.Kernel;
#endregion

public class Script_Instance : GH_ScriptInstance
{
    private void RunScript(object x, object y, ref object a)
    {
        var doc = Grasshopper.Instances.ActiveCanvas?.Document;
        if (doc == null) { a = "no doc"; return; }
        foreach (var obj in doc.Objects)
        {
            if (obj.GetType().Name != "MotusProgramPlanComponent") continue;
            var t = obj.GetType();
            var flags = BindingFlags.Instance | BindingFlags.NonPublic;
            var run = t.GetField("_run", flags)?.GetValue(obj);
            var planning = t.GetField("_planning", flags)?.GetValue(obj);
            var status = t.GetField("_status", flags)?.GetValue(obj);
            var auto = t.GetField("_autoPlan", flags)?.GetValue(obj);
            var cached = t.GetField("_cached", flags)?.GetValue(obj);
            a = $"run={run} planning={planning} auto={auto} cached={cached!=null} status={status}";
            // turn Auto Plan back off after check
            t.GetField("_autoPlan", flags)?.SetValue(obj, false);
            return;
        }
        a = "no Program";
    }
}
# ---------- end c_script_3 ----------

# ---- group: Preview
scrub = Slider(0, range=0..1)
preview = MotusPreview(
    Trajectory=program.Trajectory,
    ShowStart=True,
    Position=scrub,
    Scene=colscene_2.Scene,
    ColorMode=0,
    ShowCustomColors=False,
    ShowDebugOutputs=False,
    ShowTcp=False)  # -> Meshes, Links, TCPPath, State, Time

# ----
cassis = Cassis(
    Prefix="http://localhost:3003/mcp/",
    EnabledTools="List_CSharp_Scripts,Get_CSharp_Script,Edit_CSharp_Script,Get_CSharp_Script_Errors,List_Python_Scripts,Get_Python_Script,Edit_Python_Script,Get_Python_Script_Errors,Edit_Script,Get_AllComponents,Get_ComponentCount,Get_Component_Output,GetAllConnections,List_Panels,Get_Panel_Text,Set_Panel_Text,Get_Components_In_Group,AddComponent,GetSolutionState,Orbit_Object,Capture_Viewport,List_Viewports,Manage_NamedViews,Get_Parameter_TypeHints,Set_Component_Enabled,Set_Component_Preview,Get_Component_State,LoadDocument,SaveDocument,CloseDocument,GetDocumentInfo,ListOpenDocuments,Canvas_Snapshot,Add_CSharp_Script_Component,Modify_Script_Component_Parameters,Add_Script_Parameter,Remove_Script_Parameter,GetDetailedComponentInfo,GetDetailedComponentInfoById,Set_Component_Value,Move_Component,Connect_Components_By_Name,ConnectComponentsWithValidation,ValidateConnection,Connect_Components,ReconnectByName,Toggle_BooleanToggle,ForceDocumentSolution,ExpireComponent,RecomputeScriptComponents,Toggle_SolverExecute,Toggle_SolverReset,Capture_Canvas,Save_HiRes_Canvas,NewDocument,GetSystemHealth,RunHealthCheck,ListHealthChecks,CreateGrasshopperDefinition,OptimizeGrasshopperDefinition,TroubleshootGrasshopper,LearnGrasshopperConcept,AnalyzeGrasshopperDefinition")
