# Grasshopper definition 10_robotiq_tool.ghx (Grasshopper 1.0.8)
# plug-ins: Motus
# Motus Robot (ur10e.urdf) + Robotiq mesh via Motus Tool -> Plan + Preview.

path = FilePath("examples/ur10e/ur10e.urdf")
goalpt = ConstructPoint(X=0, Y=0, Z=0.1633)
X = UnitX()
path_2 = FilePath("examples/ur10e/meshes/robotiq_2f85/robotiq_2f85_tcp_local.stl")
goal = Plane(Origin=goalpt, Normal=X)
loadmesh = MotusLoadMesh(Path=path_2)
tool = MotusTool(Name="robotiq_2f85", TCP=goal, Geometry=loadmesh, Capabilities="Robotiq2F85")
robot = MotusRobot(Path=path, BaseLink="base_link", TipLink="tool0", Tool=tool)
joints = MotusJointState(Joints=[1.2, -1, 1.2, -1.6, -1.5708, 0])
scrub = Slider(0, range=0..1)
quick = MotusPlan(Robot=robot, Goal=joints, Step=0.005, ShowCollision=False, ShowGroup=False, ShowAttach=False, ShowRrtSettings=False)  # -> Trajectory, Status, Warnings
preview = MotusPreview(Trajectory=quick.Trajectory, ShowStart=False, Position=scrub)  # -> Meshes, Links, TCPPath, State, Time
