# Grasshopper definition 11_gripper_motion_program.ghx (Grasshopper 1.0.8)
# plug-ins: Motus
# Motion program with SET gripper close: UR10e Robotiq -> ToolState(Robot) -> Program Plan -> Preview/Export.

ur10e = MotusUR10eRobotiq()
joints = MotusJointState(Joints=[0, -0.5, 1, -1, 0, 0])
joints_2 = MotusJointState(Joints=[0, -0.5, 1, -1, 0, 0])
toolstate = MotusToolState(Tool=ur10e, Preset="Open", Width=0.085, Speed=0.5, Force=0.5)
toolstate_2 = MotusToolState(Tool=ur10e, Preset="Closed", Width=0.085, Speed=0.5, Force=0.5)
segment = MotusMotionSegment(Type="PTP", Goal=joints_2, Blend=0, ToolState=toolstate, ToolMode="Hold")
segment_2 = MotusMotionSegment(Type="SET", Blend=0, ToolState=toolstate_2, Duration=0.2)
scrub = Slider(0, range=0..1)
progplan = MotusProgramPlan(Robot=ur10e, Segments=[segment, segment_2], Start=joints)  # -> Trajectory, Status, Warnings
preview = MotusPreview(Trajectory=progplan.Trajectory, ShowStart=False, Position=scrub)  # -> Meshes, Links, TCPPath, State, Time
export = MotusExport(Trajectory=progplan.Trajectory, Retime=True, Validate=False)  # -> Json, Csv, Validation
