# Grasshopper definition 12_bamboo_mobile_robot.ghx (Grasshopper 1.0.8)
# plug-ins: Motus
# ICD/LIS bamboo brachiation robot (Kalousdian et al., RAL 2022): 5-DOF symmetric chain (Wrist-Elbow-Shoulder-Elbow-Wrist) → Pick-and-place construction motion → Preview. Web viewer shows full gripper kinematics and strut placement. Planning/preview only.

# ----
# 12 · ICD Bamboo Mobile Robot
# ICD/LIS 5-DOF brachiation: pick-and-place construction (RAL 2022). One claw fixed, other picks strut, places vertically. Web viewer shows gripper kinematics.
# Robot
urdf = Panel("assets/icd/bamboo_mobile_robot.urdf")
robot = MotusRobot(Path=urdf, BaseLink="base_link", TipLink="tool0", AllDrivers=False)

# ----
# Env + Traj
joints = MotusJointState(Joints=[0, -0.3, 0, 0.3, 0])
joints_2 = MotusJointState(Joints=[0, -0.3, 0.5, 0.3, 0])

# ----
# Plan
quick = MotusPlan(
    Robot=robot,
    Goal=joints_2,
    Start=joints,
    Step=0.005,
    AutoPlan=True,
    ShowCollision=False,
    ShowGroup=False,
    ShowAttach=False,
    ShowRrtSettings=False)  # -> Trajectory, Status, Warnings

# ----
# Play
scrub = Slider(0, range=0..1)
preview = MotusPreview(Trajectory=quick.Trajectory, ShowStart=True, Position=scrub, ColorMode=0, ShowCustomColors=False, ShowDebugOutputs=False)  # -> Meshes, Links, TCPPath, State, Time
waypoints = MotusWaypoints(Trajectory=quick.Trajectory, Decimate=1)  # -> Joints, Planes, Times
